# Grasshopper definition SnowFlakeGrowth.gh (Grasshopper 1.0.7)

extent_xy = Slider(50, range=1..50)
number_slider = Slider(1, range=1..5)
hexgrid = Hexagonal(Plane=PlaneXY(0, 0, 0), Size=number_slider, ExtentX=extent_xy, ExtentY=extent_xy)  # -> Cells, Points
pt = Point(flatten(hexgrid.Points))
python = GhPythonScript(Pt=pt)  # -> out, pL; inputs Pt: list
# ---------- python: Python ----------
__author__ = "Pradeesh Karunakaran"
__version__ = "2023.01.25"

import rhinoscriptsyntax as rs
from compas_rhino.conversions import RhinoLine,RhinoPoint
pL = []     # point list
for point in Pt:
    p = RhinoPoint.from_guid(point).to_compas()
    pL.append(p)
    
for p in pL:
    print(p)
# ---------- end python ----------
iterations = Slider(0, range=0..30)
snowflake_pts = GhPythonScript(points=python.pL, side=number_slider, number_each_side=extent_xy, iterations=iterations)  # -> out, sfList; inputs points: list, number_each_side: Int32
# ---------- snowflake_pts: Python ----------
import rhinoscriptsyntax as rs
from compas.geometry import Line, Point, Vector
from compas_ghpython.artists import PointArtist, LineArtist


def neighbour_check(x,y):
    
#    print(point)
#    print(type(point))
    if(x <= 0 or x == number_each_side - 1 or y <= 0 or y == number_each_side - 1  ):
        return False
    if(x % 2 == 0):
        eq = y
    else:
        eq = y + 1
    count = 0
    if(twoDPointList[x][y+1] in sfList):
        count += 1
    if(twoDPointList[x][y-1] in sfList):
        count += 1
    if(twoDPointList[x+1][eq] in sfList):
        count += 1
    if(twoDPointList[x+1][eq-1] in sfList):
        count += 1
    if(twoDPointList[x-1][eq] in sfList):
        count += 1
    if(twoDPointList[x-1][eq-1] in sfList):
        count += 1
    return count == 1   
        


# converting the existing point list to a 2D List for easy visualization
twoDPointList = [ [0]*number_each_side for i in range(number_each_side)]
for i in range(number_each_side * number_each_side ):
    twoDPointList[int((i / number_each_side))][i % number_each_side] = points[i]

# final snow flake list
sfList = []
initial = twoDPointList[int(0.5*number_each_side-1)][int(0.5*number_each_side-1)]
sfList.append(initial)      # this is a bit left and bottom, not exact center


# length of diagonal of a hexagon is 2*side length
# distance between sides = 2 *  side * sqrt(0.75)
diagonal = 2 * side
opposite = points[1].y - points[0].y

# check if a point in list
#print(initial in sfList)
#print(Point(0,opposite,0) in points)   # don't round it up, use the calculated values opposite and diagonal


counts = 1              # this counts is only to speed up the process
while iterations > 0:
    templist = []    
    for i in range( int(0.5*number_each_side-1 -counts-4),int(0.5*number_each_side-1 +counts+4 )):
       for j in range( int(0.5*number_each_side-1 -counts-4),int(0.5*number_each_side-1 +counts+4 )):
           if(neighbour_check(i,j)):
                templist.append(twoDPointList[i][j])
    sfList.extend(templist)
    iterations -= 1
    counts += 1
#    print(iterations)


        
print(len(sfList))
for pt in sfList:
    print(pt)
#checks if the only one neighbour is in the snow flake list
# ---------- end snowflake_pts ----------
planes = GhPythonScript(side=number_slider, sfList=snowflake_pts.sfList)  # -> out, c1, c2, c3, c4, c5, c6; inputs sfList: list
# ---------- planes: Python ----------
__author__ = "Pradeesh Karunakaran"
__version__ = "2023.02.02"

import rhinoscriptsyntax as rs
from compas.geometry import Plane, Point
from compas_rhino.conversions import plane_to_rhino,point_to_rhino
c1 = []
c2 = []
c3 = []
c4 = []
c5 = []
c6 = []
planeList = []
for pt in sfList:
    c1.append(point_to_rhino(Point(100+pt.x+0.5*side,100+pt.y-0.865*side,0)))
    c2.append(point_to_rhino(Point(100+pt.x+0.5*side,100+pt.y+0.865*side,0)))
    c3.append(point_to_rhino(Point(100+pt.x-0.5*side,100+pt.y+0.865*side,0)))
    c4.append(point_to_rhino(Point(100+pt.x-0.5*side,100+pt.y-0.865*side,0)))
    c5.append(point_to_rhino(Point(100+pt.x-side,100+pt.y,0)))
    c6.append(point_to_rhino(Point(100+pt.x+side,100+pt.y,0)))
#    planeList.append(Plane(Point(pt.x+100,pt.y+100,0), [0,0,1])) 
#print(planeList)
rhinoPlanes = []
#rhinoPlanes = [plane_to_rhino(plane) for plane in planeList]
for c in c1:
    print(c)
# ---------- end planes ----------
panel = Panel(planes.c1)
srf4pt = _4PointSurface(CornerA=planes.c4, CornerB=planes.c3, CornerC=planes.c5)
srf4pt_2 = _4PointSurface(CornerA=planes.c1, CornerB=planes.c2, CornerC=planes.c3, CornerD=planes.c4)
srf4pt_3 = _4PointSurface(CornerA=planes.c1, CornerB=planes.c2, CornerC=planes.c6, CornerD=planes.c1)
combine = GhPythonScript(s1=srf4pt_2, s2=srf4pt, s3=srf4pt_3)  # -> out, combinedSurface; inputs s1: list, s2: list, s3: list
# ---------- combine: Python ----------
__author__ = "Pradeesh Karunakaran"
__version__ = "2023.02.02"

import rhinoscriptsyntax as rs

combinedSurface = []
combinedSurface.extend(s1)
combinedSurface.extend(s2)
combinedSurface.extend(s3)
# ---------- end combine ----------
