# Grasshopper definition Snowflake pattern.gh (Grasshopper 1.0.7)

iterations = Slider(3, range=1..4)
points = Point([Point(-49.35917242, 55.98686398, 0), Point(-79.12040953, -29.57669272, 0), Point(-15.87778066, -115.1402494, 0), Point(-12.15762602, -35.15692468, 0), Point(84.56639459, -74.21854839, 0), Point(227.7923482, 76.4477145, 0), Point(41.78461624, 39.24616811, 0)])
python = GhPythonScript(points=points, iterations=iterations)  # -> out, branches; inputs points: list
# ---------- python: Python ----------
import rhinoscriptsyntax as rs
import Rhino.Geometry as rg

from compas.geometry import Line, Point, Vector
from compas.geometry import Rotation
from compas_rhino.conversions import RhinoLine,RhinoPoint

from compas_ghpython.artists import PointArtist, LineArtist

import random
import math
from math import radians

def recursiveSnowFlake(point, length, iterations, branches):
    # count down the iterations
    iterations -= 1 #'fill in here [...]decrementing iterations'
    #creating intial lines
    dir1 = Line(point+[length/2,length/2,0], point+[-length/2,-length/2,0])
    dir2 = Line(point+[length/2,length/2,0], point+[-length/2,-length/2,0])
    dir3 = Line(point+[length/2,length/2,0], point+[-length/2,-length/2,0])

    #rotating them
    R1 = Rotation.from_axis_and_angle([0,0,1], radians(60),dir2.midpoint)
    R2 = Rotation.from_axis_and_angle([0,0,1], -radians(60),dir3.midpoint)
    dir2.transform(R1)
    dir3.transform(R2)
    branches.extend([dir1,dir2,dir3])

    if(iterations >0):
        recursiveSnowFlake(dir1.start, length*0.25, iterations, branches)
        recursiveSnowFlake(dir1.end, length*0.25, iterations, branches)
        recursiveSnowFlake(dir2.start, length*0.25, iterations, branches)
        recursiveSnowFlake(dir2.end, length*0.25, iterations, branches)
        recursiveSnowFlake(dir3.start, length*0.25, iterations, branches)
        recursiveSnowFlake(dir3.end, length*0.25, iterations, branches)
    
    
    
# 1. input
#line = Line(Point(10.,10.,0), Point(-10.,-10.,0.))
#line = RhinoLine.from_geometry(line).to_compas() #  convert Rhino Line to COMPAS line, why is this commented

# 2. empty list for start
branches = []
#branches.append(line)

#points = [RhinoPoint.from_geometry(point).to_compas() for point in points]
#points = RhinoPoint.from_geometry(points).to_compas()
#for point in points:
#    print(point)

for point in points:
    length = random.uniform(2,40)
    point = RhinoPoint.from_guid(point).to_compas()
    recursiveSnowFlake(point, length, iterations, branches)
#    print(Line(Point(point+length/2,point+length/2,0), Point(point-length/2,point-length/2,0)))
# 3. call the recursive function



# 4. convert the COMPAS geometry to the Rhino Geometry
branches = [LineArtist(b).draw() for b in branches]
# ---------- end python ----------
line = Line(python.branches)
preview = CustomPreview(Geometry=line, Material=ColourSwatch(SwatchColor=RGB(84, 234, 255)))
