# Grasshopper definition Triangle Spiral - Central Rotation.gh (Grasshopper 1.0.7)

side = Slider(15, range=10..40)
iterations = Slider(34, range=0..50)
angle = Slider(26, range=5..30)
python = GhPythonScript(side=side, scale=Slider(1.1, range=1.05..1.5), angle=angle, iterations=iterations)  # -> out, branches, frames
# ---------- python: Python ----------
import rhinoscriptsyntax as rs
import Rhino.Geometry as rg

from compas.geometry import Line, Point, Vector, Frame
from compas.geometry import Rotation
from compas_rhino.conversions import RhinoLine,RhinoPoint

from compas_ghpython.artists import PointArtist, LineArtist, Artist

import random
import math
from math import radians

def recursiveTriangleSpiral(side, branches,frameList, iteration = 0,startAngle=0):
    iteration += 1
    side1 = Line([-side/2,-side/(2*math.sqrt(3)),0],Point(side/2,-side/(2*math.sqrt(3)),0))
    side2 = Line([-side/2,-side/(2*math.sqrt(3)),0],Point(side/2,-side/(2*math.sqrt(3)),0))
    side3 = Line([-side/2,-side/(2*math.sqrt(3)),0],Point(side/2,-side/(2*math.sqrt(3)),0))
    R = Rotation.from_axis_and_angle([0,0,1], radians(startAngle))
    side1.transform(R)
    side2.transform(R)
    side3.transform(R)
    
#add side 2.end
        #rotating them
    R1 = Rotation.from_axis_and_angle([0,0,1], radians(60),side1.start)
    R2 = Rotation.from_axis_and_angle([0,0,1], -radians(60),side1.end)
    side2.transform(R1)
    #notice that coordinate of the second vector should be -1 in order to have Z axis allocate into the right direction for robots
    frameList.extend([Frame([30, 0, 0], [1, 0,0], [0, -1, 0]),Frame(side1.start, [1, 0, 0], [0, -1, 0]),Frame(side1.end, [1, 0, 0], [0, -1, 0]),Frame(side2.end, [1, 0, 0], [0, -1, 0]),Frame(side1.start, [1, 0, 0], [0, -1, 0])])
    side3.transform(R2)
    branches.extend([side1, side2, side3])
    
    if(iteration <iterations):
        recursiveTriangleSpiral(side*scale, branches,frameList, iteration, startAngle+angle)
        
# 2. empty list for start
branches = []
iteration = 0
startAngle = 0
frameList = []
recursiveTriangleSpiral(side, branches, frameList, iteration,startAngle)
# 4. convert the COMPAS geometry to the Rhino Geometry
branches = [LineArtist(b).draw() for b in branches]
#in order geometries to be depicted correctly in grasshopper, you need to draw them (basically, same as you did for the lines) 
frames = [Artist(f).draw()for f in frameList]


# note. Angle = 12 for Triangle Spiral, Angle = 22,27 for floral pattern and Angle =30 for Star pattern 
# maintain scale = 1.10
# ---------- end python ----------
panel = Panel(python.frames)
pln = Plane(python.frames)
line = Line(python.branches)
preview = CustomPreview(Geometry=line, Material=ColourSwatch(SwatchColor=RGB(228, 86, 103)))
