# Grasshopper definition assignment_2a_recursion_branches_lines.ghx (Grasshopper 1.0.7)

recursion2d = PythonScript(redraw=Button(), iterations=Slider(7, range=1..10), make3D=Toggle(True), omit=Toggle(True))  # -> out, branches; inputs iterations: Int32, make3D: Boolean
# ---------- recursion2d: Python ----------
# this creates random branching lines with recursion
# input type: line

import Rhino.Geometry as rg

from compas.geometry import Line, Point, Vector
from compas.geometry import Rotation

from compas_ghpython.artists import PointArtist, LineArtist

import random
import math


def recursiveLine(line, iteration, branches):
    
    # count down the iterations
    iteration -= 1 #'fill in here [...]decrementing iterations'
    
    # get the start and end points of the input line
    start_point = line.start #'fill in here [...] not sure what to do'
    end_point = line.end #'fill in here [...]'
    
    # get the vector of the input line, 2 times for the two branches
    dir1 = Vector.from_start_end(start_point, end_point)  #'fill in here [...]'
    dir2 = Vector.from_start_end(start_point, end_point) #'fill in here [...]'
    
    # --> for the angle, calculate a random positive and negative angle between 0.1 and 0.5
    angle1 = random.uniform(0.1, 0.4)
    angle2 = random.uniform(-0.1, -0.4)
    
    # and rotate the vector along this angles in + and - direction
    R1 = Rotation.from_axis_and_angle([0.0, 1.0, 0.0], angle1)
    R2 = Rotation.from_axis_and_angle([0.0, 1.0, 0.0], angle2)
    
    dir1.transform(R1)
    dir2.transform(R2)

    if make3D == True:
        dir1.transform(R1)
        dir2.transform(R2)
        angle1 = random.uniform(-math.pi*2, math.pi*2)
        angle2 = random.uniform(-math.pi*2, math.pi*2)
        R1 = Rotation.from_axis_and_angle(line.vector, angle1)
        R2 = Rotation.from_axis_and_angle(line.vector, angle2) 
        dir1.transform(R1)
        dir2.transform(R2)
    
    # for the scale, calculate a random scale between 0.9 and 1.0
    scale1 = random.uniform(0.9, 1.0)
    scale2 = random.uniform(0.9, 1.0)

    # and scale the vector according to the scale values
    dir1 = dir1 * scale1  #'fill in here [...]'
    dir2 = dir2 * scale2  #'fill in here [...]'
    
    # finally, create two new branches
    line1_start_point =  end_point
    line1_end_point =   line1_start_point+ Point(dir1.x,dir1.y,dir1.z)  #this line was messing up the code'fill in here [...]'
    line2_start_point =  end_point
    line2_end_point =  line2_start_point + Point(dir2.x,dir2.y,dir2.z)#'fill in here [...]'
    
    line1 = Line(line1_start_point, line1_end_point)
    line2 = Line(line2_start_point, line2_end_point)
#    line1 = Line(line1_end_point, line1_start_point)
#    line2 = Line(line2_end_point, line2_start_point)
#    
    # and add them to the list of branches
    branches.extend([line1,line2])  #'fill in here [...]'
#    print(line1," and ", line2)
    
    # if the iteration is higher than zero, keep calling the function recursively
    if iteration > 0:
        omit_value = 0.9 if omit else 1.0
            
        if(random.random()<omit_value): # random omission
            # call the recursive function with line 1 as input
            recursiveLine(line1, iteration, branches) #'fill in here [...]'
        if(random.random()<omit_value): # random omission
            # call the recursive function with line 2 as input
            recursiveLine(line2, iteration, branches)  #'fill in here [...]'

# 1. input
line = Line(Point(0.,0.,0), Point(0.,0.,1.))
# line = RhinoLine.from_geometry(line).to_compas() #  convert Rhino Line to COMPAS line, why is this commented

# 2. empty list for start
branches = []
branches.append(line)

# 3. call the recursive function
recursiveLine(line, iterations, branches)


# 4. convert the COMPAS geometry to the Rhino Geometry
branches = [LineArtist(b).draw() for b in branches]
# ---------- end recursion2d ----------
line = Line(recursion2d.branches)
preview = CustomPreview(Geometry=line, Material=ColourSwatch(SwatchColor=RGB(76, 218, 191)))
