# Grasshopper definition assignment_1_mesh_traverse.ghx (Grasshopper 1.0.7)

# ----
# Assignment Data Structures (using data/faces.obj):
# 
# Define a function for traversing the mesh from boundary
# to boundary in a "straight" line and visualise the result.
number_slider = Slider(19, range=0..19)
mesh_viz = GhPythonScript(
    show_labels_all_keys=Toggle(False),
    show_labels_boundary=Toggle(True),
    show_labels_neighbors_start=Toggle(True),
    show_labels_neighbors_current=Toggle(True),
    show_labels_path=Toggle(True),
    start_boundary_vertex_idx=number_slider)  # -> out, vertices, edges, faces, labels, start_vertex, vertices_start_neighbors, labels_start_neighbors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; inputs start_boundary_vertex_idx: Int32
# ---------- mesh_viz: Python ----------
import sys, os
import ghpythonlib.components as ghcomp
import compas
from compas.datastructures import Mesh
from compas_ghpython.artists import MeshArtist

ghComp = ghenv.Component
ghDoc = ghComp.OnPingDocument()
import Rhino.Geometry as rg

# the full path of the gh file
path_gh_file = ghDoc.FilePath

# the directory of the gh file
HERE = os.path.dirname(path_gh_file)
DATA = os.path.join(HERE, 'data')
FILE = os.path.join(DATA, 'faces.obj')

mesh = Mesh.from_obj(FILE)    # importing the grasshopper file 

artist = MeshArtist(mesh)   
vertices = artist.draw_vertices()
edges = artist.draw_edges()
faces = artist.draw_faces()   # importing the vertex, edge and face artists

# Visualize the vertices and labels
if show_labels_all_keys:
    vertices = artist.draw_vertices()               # draw vertices
    labels = {key: key for key in mesh.vertices()}  # key shows vertex ID while attr shows the coordinate, so here only ID

# Visualize additionally the vertices and labels on the boundary
if show_labels_boundary:
    keys = list(mesh.vertices_on_boundary())        # fetches the boundary vertices into a list
    vertices = artist.draw_vertices(vertices=keys)  # same process as above for boundary vertices
    labels = [key for key in keys]                  

# Select one vertex on the boundary
boundary_keys = list(mesh.vertices_on_boundary())   # fetches boundary vertices as a list
boundary_keys = sorted(boundary_keys)               # sorts them in order
#print(boundary_keys)                                # Why do I have two 0s [0, 0, 1, 2, 3, 4, 5, 6, 11, 12, 17, 18, 23, 24, 29, 30, 31, 32, 33, 34, 35]
boundary_keys = boundary_keys[1:]                   # discarded a duplicate boundary vertex
#print(boundary_keys)                               # now working
start = boundary_keys[start_boundary_vertex_idx]    # gets the index of a boundary vertex. There are 20 boundary vertices, index 0 to 19
start_vertex = artist.draw_vertices([start])        # draws the start vertex


# Find the neighbours of this vertex
nbrs = mesh.vertex_neighbors(start)                 #retuns the vertex neighbours in a list

# Check, if the start vertex has at least 3 neighbors
#if len(nbrs) < 3:                                # only if its a corner vertex, so either leftmost or right most
#    if start_boundary_vertex_idx==0:        
#      start_boundary_vertex_idx += 1              # increment if it starts from 0. Why ? expl: starting from any boundary vertex not on the corner
#    else:
#      start_boundary_vertex_idx -= 1              # decrement if it doesn't start from 0. why ? expl: if the right most, deduct one
#    start = boundary_keys[start_boundary_vertex_idx]  
#    start_vertex = artist.draw_vertices([start])     
#    nbrs = mesh.vertex_neighbors(start)             

# Visualize the vertices and labels of the neighbors at start 
if show_labels_neighbors_start:                     # visualize neighbours of start
    keys = nbrs
    vertices_start_neighbors = artist.draw_vertices(vertices=keys)
    labels_start_neighbors = [key for key in keys]

# Find the neighbor not on the boundary:
#current = start
#previous = start                                       # start vertex, start = boundary_keys[start_boundary_vertex_idx] 
#for nbr in nbrs:
##    print(nbr, mesh.is_vertex_on_boundary(nbr))
#    if not mesh.is_vertex_on_boundary(nbr):
#        previous, current = current, nbr                # if some neighbour is not in boundary, current = current vertex(nbr) and previous = current
#        break

# Find the neighbours of the new vertex in cycling order  # for the non-boundary vertex, the process is repeated
#nbrs = mesh.vertex_neighbors(current, ordered=True)

# Find the opposite neighbour of the previous vertex    
#i = nbrs.index(previous)                                # the initial current became the previous
#previous, current = current, nbrs[i - 2]                # resetting the previous to current and current to the 
#print(previous, current)
#nbrs = mesh.vertex_neighbors(current, ordered=True)     # repeating the process for current


# ---------------------------------------------------------------------------------------------------------------------------------
# Assignment: Define a function for traversing the mesh from boundary to boundary in a "straight" line and visualise the result.
# 1a. Get the current neighbor keys from the start key
# 1b. Find the key in the current neighbor keys which is not on the boundary, which is the next key for the path
# 1c. Make a while loop, that finds the keys for the path until it reaches the opposite side
# ---------------------------------------------------------------------------------------------------------------------------------

# ---------------------------------------------------------------------------------------------------------------------------------
# Note: The traversal works in both directions, horizontal and vertical. Traversal along boundary is enabled, to disable, uncomment line 2052 to 2057
# ---------------------------------------------------------------------------------------------------------------------------------
def mesh_traverse_main(mesh, current, path):
    meshlist = []
    meshList = list(mesh.vertices())
    #
    path.append(current)
    #determining direction of mesh traversal, 0 is horizontal and 1 is vertical
    direction = 0
    if (current in boundary_keys[:int(len(boundary_keys)/4+1)]) or current in boundary_keys[int(len(boundary_keys)*3/4-1):] :
        direction = 1
    return mesh_traverse_helper(mesh, meshList, current, direction, path)

def mesh_traverse_helper(mesh,meshlist, current, direction, path):  # only corner vertex has 2 neighbours, boundary has 3, inner has 4
  if direction == 1:
      if sorted(mesh.vertex_neighbors(current, ordered=True))[-1]-current >1:
          while(sorted(mesh.vertex_neighbors(current, ordered=True))[-1]-current >1):
              nbrs = sorted(mesh.vertex_neighbors(current, ordered=True))
              path.append(nbrs[-1])
              current = nbrs[-1]
      else:
          while(current - sorted(mesh.vertex_neighbors(current, ordered=True))[0] >1):
              nbrs = sorted(mesh.vertex_neighbors(current, ordered=True))
              path.append(nbrs[0])
              current = nbrs[0]

  else:
      if current + 1 in mesh.vertex_neighbors(current, ordered=True):
          while(current + 1 in mesh.vertex_neighbors(current, ordered=True)):
            current = current+1
            path.append(current)
      else:
          while(current - 1 in mesh.vertex_neighbors(current, ordered=True)):
            current = current-1
            path.append(current)
  return path


#start = boundary_keys[start_boundary_vertex_idx]    #always a boundary key
current = start
path = [] # path with starting key, then further will be appended
path = mesh_traverse_main(mesh, current, path)
print(path)


# Visualize the vertices and labels of the path
if show_labels_path:
    keys = path
    vertices_path = artist.draw_vertices(vertices=keys)
    labels_path = [key for key in keys]
    

# Visualize the vertices and labels of the neighbors at current
if show_labels_neighbors_current:
    keys = mesh.vertex_neighbors(current, ordered=True)                                         # nbrs = mesh.vertex_neighbors(current, ordered=True)
    vertices_current_neighbors = artist.draw_vertices(vertices=keys)
    labels_current_neighbors = [key for key in keys]

current_vertex = artist.draw_vertices([current])
# ---------- end mesh_viz ----------
pt = Point(mesh_viz.vertices)
line = Line(mesh_viz.edges)
mesh = Mesh(mesh_viz.faces)
pt_2 = Point(mesh_viz.start_vertex)
pt_3 = Point(mesh_viz.vertices_start_neighbors)
pt_4 = Point(mesh_viz.vertices_path)
pt_5 = Point(mesh_viz.current_vertex)
pt_6 = Point(mesh_viz.vertices_current_neighbors)
tag = TextTag(Location=pt, Text=mesh_viz.labels, Colour=ColourSwatch(SwatchColor=RGB(0, 0, 0)))
tag_2 = TextTag(Location=pt_4, Text=mesh_viz.labels_path, Colour=ColourSwatch(SwatchColor=RGB(0, 0, 0)))
tag_3 = TextTag(Location=pt_3, Text=mesh_viz.labels_start_neighbors, Colour=ColourSwatch(SwatchColor=RGB(0, 0, 0)))
tag_4 = TextTag(Location=pt_6, Text=mesh_viz.labels_current_neighbors, Colour=ColourSwatch(SwatchColor=RGB(0, 0, 0)))
preview = CustomPreview(Geometry=[line, pt_3, pt_6], Material=ColourSwatch(SwatchColor=RGB(255, 248, 184)))
preview_2 = CustomPreview(Geometry=mesh, Material=ColourSwatch(SwatchColor=RGB(178, 178, 178)))
preview_3 = CustomPreview(Geometry=[pt_5, pt_2], Material=ColourSwatch(SwatchColor=RGB(255, 217, 217)))
preview_4 = CustomPreview(Geometry=pt_4, Material=ColourSwatch(SwatchColor=RGB(255, 120, 120)))
