# Grasshopper definition assignment_2_network_traverse_workaround_networkartist.ghx (Grasshopper 1.0.7)

# ----
# Assignment Data Structures (using data/lines.obj):
# 
# Define a function for traversing the network from
# one leaf to the furthest leaf and visualise the result.
number_slider = Slider(1, range=0..20)
network_viz = GhPythonScript(
    show_labels_all_keys=Toggle(False),
    show_labels_leaves=Toggle(False),
    show_leaf_neighbors=Toggle(True),
    show_labels_leaf_neighbors=Toggle(True),
    show_path=Toggle(False),
    show_labels_path=Toggle(False),
    neighborhood_ring=number_slider,
    start_leaf_key=Slider(7, range=0..20))  # -> out, nodes, edges, leaves_nodes, current_leaf, current_leaf_neighbors, current_leaf_neighbors_nodes, path_to_end_leaf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; inputs neighborhood_ring: Int32, start_leaf_key: Int32
# ---------- network_viz: Python ----------
import sys, os
import ghpythonlib.components as ghcomp
import compas
from compas.datastructures import Network
from compas_ghpython.artists import NetworkArtist
from compas_rhino.geometry import RhinoLine
from compas_ghpython.utilities import draw_lines

import compas_ghpython
import Rhino.Geometry as rg

ghComp = ghenv.Component
ghDoc = ghComp.OnPingDocument()

# the full path of the gh file
path_gh_file = ghDoc.FilePath

# the directory of the gh file
HERE = os.path.dirname(path_gh_file)
DATA = os.path.join(HERE, 'data')
FILE = os.path.join(DATA, 'lines.obj')

# load network
network = Network.from_obj(FILE)

# draw network in Rhino
#artist = NetworkArtist(network)
#nodes, edges = artist.draw()
#edges = draw_lines(network.edges())
edges = []
for start, end in network.edges():
    print start
    #edges.append(draw_lines(edge))

# show labels
if show_labels_all_keys:
    labels = {key: key for key in network.nodes()}

if show_labels_leaves:
    leaves_nodes = artist.draw_nodes(nodes=network.leaves())
    leaves_labels = {key: key for key in network.leaves()}


# draw current selected leaf
leaf_ids = network.leaves()
start_key = leaf_ids[start_leaf_key]
current_leaf = {'pos': network.node_coordinates(start_key), 'radius': 0.2}
current_leaf = compas_ghpython.draw_spheres([current_leaf])

# get leaf neighbors and display in Rhino
current_leaf_neighbors_keys = []
for i in range(neighborhood_ring):
    current_leaf_neighbors_keys.extend(network.neighborhood(start_key, i+1))

if show_leaf_neighbors:
    current_leaf_neighbors = [{'pos': network.node_coordinates(key), 'radius': 0.15} for key in current_leaf_neighbors_keys]
    current_leaf_neighbors = compas_ghpython.draw_spheres(current_leaf_neighbors)

if show_labels_leaf_neighbors:
    current_leaf_neighbors_nodes = artist.draw_nodes(nodes=current_leaf_neighbors_keys)
    labels_neighbors = [key for key in current_leaf_neighbors_keys]

# ---------------------------------------------------------------------------------------------------------------------
# Assignment 2a: Find the furthest leaf/leaves, using topology
# ---------------------------------------------------------------------------------------------------------------------
"""
''' Add code here '''

end_leaf_key = # integer value describing the key of the end leaf

# display the end_leaf
end_leaf = {'pos': network.node_coordinates(end_leaf_key), 'radius': 0.2}
end_leaf = compas_ghpython.draw_spheres([end_leaf])

# ---------------------------------------------------------------------------------------------------------------------
# Assignment 2b: Show the path taken to the goal
# ---------------------------------------------------------------------------------------------------------------------

''' Add code here '''

path_keys = # list of keys describing the path from start to end leaf

# display the path to the end_leaf
if show_path:
    path_to_end_leaf = [{'pos': network.node_coordinates(key), 'radius': 0.15} for key in path_keys]
    path_to_end_leaf = compas_ghpython.draw_spheres(path_to_end_leaf)

if show_labels_path:
    path_to_end_leaf_nodes = artist.draw_nodes(nodes=path_keys)
    labels_path = [key for key in path_keys]"""
# ---------- end network_viz ----------
pt = Point(network_viz.nodes)
line = Line(network_viz.edges)
pt_2 = Point(network_viz.leaves_nodes)
brep = Brep(network_viz.current_leaf)
brep_2 = Brep(network_viz.current_leaf_neighbors)
pt_3 = Point(network_viz.current_leaf_neighbors_nodes)
brep_3 = Brep(network_viz.path_to_end_leaf)
pt_4 = Point(network_viz.path_to_end_leaf_nodes)
brep_4 = Brep(network_viz.end_leaf)
preview = CustomPreview(Geometry=pt, Material=ColourSwatch(SwatchColor=RGB(255, 0, 0)))
preview_2 = CustomPreview(Geometry=brep_2, Material=ColourSwatch(SwatchColor=RGB(238, 46, 255)))
preview_3 = CustomPreview(Geometry=brep_3, Material=ColourSwatch(SwatchColor=RGB(255, 144, 0)))
tag = TextTag(Location=pt, Text=network_viz.labels, Colour=ColourSwatch(SwatchColor=RGB(0, 0, 0)))
tag_2 = TextTag(Location=pt_3, Text=network_viz.labels_neighbors, Colour=ColourSwatch(SwatchColor=RGB(0, 0, 0)))
preview_4 = CustomPreview(Geometry=line, Material=ColourSwatch(SwatchColor=RGB(255, 48, 48)))
preview_5 = CustomPreview(Geometry=brep, Material=ColourSwatch(SwatchColor=RGB(234, 255, 0)))
preview_6 = CustomPreview(Geometry=brep_4, Material=ColourSwatch(SwatchColor=RGB(255, 48, 48)))
tag_3 = TextTag(Location=pt_2, Text=network_viz.labels_leaves, Colour=ColourSwatch(SwatchColor=RGB(0, 0, 0)))
tag_4 = TextTag(Location=pt_4, Text=network_viz.labels_path, Colour=ColourSwatch(SwatchColor=RGB(0, 0, 0)))

# ----
# Network Viz
number_slider_2 = Slider(0, range=0..47)
show = BooleanToggle(True)
network_viz_2 = GhPythonScript(show_network=show, key=number_slider_2)  # -> out, nodes, edges, current_node, current_node_neighbors; inputs key: Int32
# ---------- network_viz_2: Python ----------
import sys, os
import ghpythonlib.components as ghcomp
import compas
from compas.datastructures import Network
from compas_ghpython.artists import NetworkArtist
from compas_ghpython.utilities import draw_lines, draw_points

import compas_ghpython
import Rhino.Geometry as rg


def draw_network(network):
    """Draw a network in Grasshopper.
    """
    points = []
    for key, attr in network.nodes(True):
        points.append({
            'pos': network.node_coordinates(key),
        })

    lines = []
    for (u, v), attr in network.edges(True):
        lines.append({
            'start': network.node_coordinates(u),
            'end': network.node_coordinates(v),
        })

    points_rg = draw_points(points)
    lines_rg = draw_lines(lines)

    return points_rg, lines_rg

if show_network:
    nodes, edges = draw_network(assembly.network)
# ---------- end network_viz_2 ----------
line_2 = Line(network_viz_2.edges)
pt_5 = Point(network_viz_2.nodes)
brep_5 = Brep(network_viz_2.current_node)
brep_6 = Brep(network_viz_2.current_node_neighbors)
preview_7 = CustomPreview(Geometry=brep_6, Material=ColourSwatch(SwatchColor=RGB(255, 207, 207)))
preview_8 = CustomPreview(Geometry=brep_5, Material=ColourSwatch(SwatchColor=RGB(0, 0, 0)))
